vi "Root1.gvi"   [LabVIEW NXG 2.1.0]
panel controls:
  "input 0": f64
  "input 1": f64
  "input 1_2": f64
panel indicators:
  "Output": i32
diagram:
  Divide(x=$"input 0", y=$"input 1") -> w1
  Multiply(w1, $"input 1_2") -> w2
  Square(x=w1) -> w3
  Is Greater Than 0(x=w2) -> w4
  case (w4) {
    frame False, Default {
      # TODO:Fill in code
      w5 = default
    }
    frame True {
      To Byte Integer(number=w3) -> w6
      In Range And Coerce(lower limit=0, upper limit=100, x=w6) -> (coerced(x)=w7)
      for (N = w7) (iteration -> i1) {
        append i1 to w8
      }
      Add Array Elements(numeric array=w8) -> (sum=w5)
    }
  }
  Increment(x=w5) -> w9
  Square(x=w9) -> w10
  $Output <- w10
